# Grasshopper definition a2_star.gh (Grasshopper 0.9.80)

number_slider = Slider(15, range=3..24)
construct_point = ConstructPoint(XCoordinate=0, YCoordinate=0, ZCoordinate=0)
shape = Slider(0.323, range=-1..1)
polygon = Polygon(Plane=construct_point, Radius=number_slider, Segments=Slider(15, range=3..24), FilletRadius=0)  # -> Polygon, Length
explode = Explode(Curve=polygon.Polygon, Recursive=True)  # -> Segments, Vertices
multiplication = Multiplication(A=shape, B=number_slider)
point_on_curve = PointOnCurve(explode.Segments, parameter=0.5)
vector_2pt = Vector2Pt(PointA=construct_point, PointB=point_on_curve, Unitize=False)  # -> Vector, Length
amplitude = Amplitude(Vector=vector_2pt.Vector, Amplitude=multiplication)
move = Move(Geometry=point_on_curve, Motion=amplitude)  # -> Geometry, Transform
cardboard = Slider(1.3, range=-10..20)
weave = Weave(Pattern=[0, 1], Stream0=explode.Vertices, Stream1=move.Geometry, NullGaps=False)
polyline = PolyLine(Vertices=weave, Closed=True)
point = Point(Point(0.01987481912, -0.6993603997, 0))
rectangle = Rectangle(Plane=point, XSize=Slider(-32, range=-50..50), YSize=cardboard, Radius=0)  # -> Rectangle, Length
region_difference = RegionDifference(CurvesA=polyline, CurvesB=rectangle.Rectangle)
