# Grasshopper definition stars_2018Feb9a.gh (Grasshopper 0.9.76)

number_slider = Slider(8.088, range=3..24)
shape = Slider(-0.434, range=-1..1)
pt = ConstructPoint(XCoordinate=0, YCoordinate=0, ZCoordinate=0)
polygon = Polygon(Plane=pt, Radius=number_slider, Segments=Slider(5, range=3..24), FilletRadius=0)  # -> Polygon, Length
explode = Explode(Curve=polygon.Polygon, Recursive=True)  # -> Segments, Vertices
multiplication = Multiplication(A=shape, B=number_slider)
curvepoint = PointOnCurve(explode.Segments, parameter=0.5)
vec2pt = Vector2Pt(PointA=pt, PointB=curvepoint, Unitize=False)  # -> Vector, Length
amp = Amplitude(Vector=vec2pt.Vector, Amplitude=multiplication)
move = Move(Geometry=curvepoint, Motion=amp)  # -> Geometry, Transform
weave = Weave(Pattern=[0, 1], Stream0=explode.Vertices, Stream1=move.Geometry, NullGaps=False)
pline = PolyLine(Vertices=weave, Closed=True)
